# Grasshopper definition 20181005_tim_parentRectangle.gh (Grasshopper 1.0.4)

pt = Point(Point(-4.27978995, -8.000737995, 0))
原点 = Point(pt)
角度 = Integer(Slider(0, range=0..360))
边号 = Integer([Slider(0, range=0..3), Slider(2, range=0..3)])
位距 = Number([Slider(5.61, range=0..20), Slider(5.48, range=0..20)])
boolean = Boolean([Toggle(False), Toggle(True)])
偏移 = Number([Slider(0, range=0..10), Slider(0, range=0..10)])
相位 = Integer([Slider(0, range=0..3), Slider(1, range=0..3)])
宽深 = Number([Slider(6.17, range=0..100), Slider(3.33, range=0..100)])
pt_2 = PointOriented(BasePlane=原点, UComponent=0, VComponent=0, WComponent=0)
rad = Radians(Degrees=角度)
item = ListItem(List=相位, Index="0", Wrap=True)
path = DataPath("0")
prot = RotatePlane(Plane=pt_2, Angle=rad)
lng = ListLength(List=相位)
series = Series(Start=相位, Step=1, Count=3)
mod = Modulus(A=相位, B=2)
addition = Addition(A=item, B=边号)

# ---- group: 非短路判断
mod_2 = Modulus(A=addition, B=2)
item_2 = ListItem(List=宽深, Index=mod_2, Wrap=True)
larger = LargerThan(FirstNumber=位距, SecondNumber=item_2)  # -> LargerThan, OrEqualTo
and = GateAnd(A=larger.LargerThan, B=boolean)
sift = SiftPattern(List=graft(位距), SiftPattern=graft(and))  # -> Output0, Output1
sift_2 = SiftPattern(List=graft(item_2), SiftPattern=graft(and))  # -> Output0, Output1
combine = CombineData(Input0=sift.Output0, Input1=sift_2.Output1)  # -> Result, Index
实位距 = Number(combine.Result)

# ----
panel = Panel("""0
0.5*Pi
Pi
1.5*Pi""")
pln = Plane(prot)
panel_2 = Panel("""0,1,0
1,0,1""")
deplane = DeconstructPlane(Plane=pln)  # -> Origin, XAxis, YAxis, ZAxis
Z = UnitZ(Factor=1)
num = Number(panel)
item_3 = ListItem(List=panel_2, Index=mod, Wrap=True)
vrot = Rotate(Vector=deplane.XAxis, Axis=Z, Angle=num)
split = TextSplit(Text=item_3, Separators=",")
addition_2 = Addition(A=addition, B=1)
vec = Vector(vrot)
item_4 = ListItem(List=vec, Index=addition, Wrap=True)
item_5 = ListItem(List=vec, Index=series, Wrap=True)
item_6 = ListItem(List=宽深, Index=split, Wrap=True)
item_7 = ListItem(List=vec, Index=addition_2, Wrap=True)
vec_2 = VectorXYZ(XComponent=0, YComponent=0, ZComponent=0)  # -> Vector, Length
amp = Amplitude(Vector=item_5, Amplitude=item_6)
amp_2 = Amplitude(Vector=item_7, Amplitude=偏移)
amp_3 = Amplitude(Vector=graft(item_4), Amplitude=实位距)
stack = StackData(Data=vec_2.Vector, Stack=lng)  # -> graft(Data)
ma = MassAddition(Input=amp)  # -> Result, PartialResults
merge = Merge(Data1=stack, Data2=ma.PartialResults)
pshift = ShiftPaths(Data=merge, Offset=1)
addition_3 = Addition(A=deplane.Origin, B=pshift)
branch = TreeBranch(Tree=addition_3, Path=path, MaintainPaths=True)
item_8 = ListItem(List=branch, Index=边号, Wrap=True)
addition_4 = Addition(A=graft(item_8), B=amp_3)
addition_5 = Addition(A=addition_4, B=graft(amp_2))
pshift_2 = ShiftPaths(Data=addition_5, Offset=1)
位距点 = Point(addition_4)
偏移点 = Point(pshift_2)
位点 = Point(偏移点)
pline = PolyLine(Vertices=addition_3, Closed=True)
矩形 = Rectangle(pline)

# ---- group: 与图形匹配数据工作条
边号_2 = Slider(3, range=0..3)
边号_3 = Slider(1, range=0..3)
位相 = Slider(2, range=0..3)
角度_2 = Slider(0, range=0..360)
位距_2 = Slider(4.74, range=0..50)
位距_3 = Slider(8.32, range=0..50)
偏移_2 = Slider(0, range=0..50)
宽 = Slider(15.35, range=3..50)
深 = Slider(11.58, range=3..50)
boolean_toggle = BooleanToggle(True)
boolean_toggle_2 = BooleanToggle(False)

# ----
list = ValueList({"厂区": 0, "加油站": 1, "农田": 2, "综合楼": 3, "空地": 4, "政府机构": 5, "绿化": 6, "住宅区": 7, "沿街商铺": 8, "小区": 9, "医院": 10, "社区服务中心": 11, "停车场": 12, "学校": 13, "教堂(社)": 14}, selected="厂区")
pt_3 = Point(Point(48.42783894, 100.6023551, 0))

# ---- group: 确定数据
宽深_2 = Panel("""12.65
9.87""")
位距_4 = Panel("""8.45
12.6""")
偏移_3 = Panel("0")
panel_3 = Panel("""1
0""")
位相_2 = Panel("1")
边号_4 = Panel("""0
3""")

# ----
cluster = Cluster(
    建筑类型=list,
    原点=pt_3,
    角度=角度_2,
    位相=位相,
    宽深=[宽, 深],
    边号=[边号_2, 边号_3],
    位距=[位距_2, 位距_3],
    偏移=偏移_2,
    boolean=[boolean_toggle, boolean_toggle_2])  # -> 矩形_2, 位点_2, 角度_3, 确认数据_2
位相_3 = Slider(0, range=0..3)
宽_2 = Slider(6.75, range=3..50)
深_2 = Slider(4.44, range=3..50)
bang = ExplodeTree(Data=graft(cluster.位点_2))  # -> flatten(Branch0), flatten(Branch1)
list_2 = ValueList({"厂区": 0, "加油站": 1, "农田": 2, "综合楼": 3, "空地": 4, "政府机构": 5, "绿化": 6, "住宅区": 7, "沿街商铺": 8, "小区": 9, "医院": 10, "社区服务中心": 11, "停车场": 12, "学校": 13, "教堂(社)": 14}, selected="厂区")
pt_4 = Point(bang.Branch1)
cluster_2 = Cluster(建筑类型=list_2, 原点=bang.Branch1, 角度=cluster.角度_3, 位相=位相_3, 宽深=[宽_2, 深_2], 边号=0)  # -> 矩形_2, 位点_2, 角度_3, 确认数据_2
panel_4 = Panel(cluster_2.确认数据_2)

# ==== cluster Cluster
建筑类型 = ClusterInput()
原点 = ClusterInput()
角度 = ClusterInput()
位相 = ClusterInput()
宽深 = ClusterInput()
边号 = ClusterInput()
位距 = ClusterInput()
偏移 = ClusterInput()
boolean = ClusterInput()
分参 = ClusterInput()
建筑类型_2 = Text(建筑类型)
原点_2 = Point(原点)
角度_2 = Integer(角度)
边号_2 = Integer(边号)
boolean_2 = Boolean(boolean)
位距_2 = Number(位距)
偏移_2 = Number(偏移)
位相_2 = Integer(位相)
宽深_2 = Number(宽深)
分参_2 = Integer(分参)
pt = PointOriented(BasePlane=原点_2, UComponent=0, VComponent=0, WComponent=0)
rad = Radians(Degrees=角度_2)
item = ListItem(List=位相_2, Index="0", Wrap=True)
path = DataPath("0")
prot = RotatePlane(Plane=pt, Angle=rad)
lng = ListLength(List=位相_2)
series = Series(Start=位相_2, Step=1, Count=3)
mod = Modulus(A=位相_2, B=2)
addition = Addition(A=item, B=边号_2)

# ---- group: 非短路判断
mod_2 = Modulus(A=addition, B=2)
item_2 = ListItem(List=宽深_2, Index=mod_2, Wrap=True)
larger = LargerThan(FirstNumber=位距_2, SecondNumber=item_2)  # -> LargerThan, OrEqualTo
and = GateAnd(A=larger.LargerThan, B=boolean_2)
sift = SiftPattern(List=graft(位距_2), SiftPattern=graft(and))  # -> Output0, Output1
sift_2 = SiftPattern(List=graft(item_2), SiftPattern=graft(and))  # -> Output0, Output1
combine = CombineData(Input0=sift.Output0, Input1=sift_2.Output1)  # -> Result, Index
pshift = ShiftPaths(Data=combine.Result, Offset=-1)
实位距 = Number(pshift)

# ----
panel = Panel("""0
0.5*Pi
Pi
1.5*Pi""")
pln = Plane(prot)
panel_2 = Panel("""0,1,0
1,0,1""")
deplane = DeconstructPlane(Plane=pln)  # -> Origin, XAxis, YAxis, ZAxis
Z = UnitZ(Factor=1)
num = Number(panel)
item_3 = ListItem(List=panel_2, Index=mod, Wrap=True)
vrot = Rotate(Vector=deplane.XAxis, Axis=Z, Angle=num)
split = TextSplit(Text=item_3, Separators=",")
addition_2 = Addition(A=addition, B=1)
vec = Vector(vrot)
item_4 = ListItem(List=vec, Index=addition, Wrap=True)
item_5 = ListItem(List=vec, Index=series, Wrap=True)
item_6 = ListItem(List=宽深_2, Index=split, Wrap=True)
item_7 = ListItem(List=vec, Index=addition_2, Wrap=True)
vec_2 = VectorXYZ(XComponent=0, YComponent=0, ZComponent=0)  # -> Vector, Length
amp = Amplitude(Vector=item_5, Amplitude=item_6)
amp_2 = Amplitude(Vector=item_7, Amplitude=偏移_2)
amp_3 = Amplitude(Vector=item_4, Amplitude=实位距)
stack = StackData(Data=vec_2.Vector, Stack=lng)  # -> graft(Data)
ma = MassAddition(Input=amp)  # -> Result, PartialResults
merge = Merge(Data1=stack, Data2=ma.PartialResults)
pshift_2 = ShiftPaths(Data=merge, Offset=1)
addition_3 = Addition(A=deplane.Origin, B=pshift_2)
branch = TreeBranch(Tree=addition_3, Path=path, MaintainPaths=True)
item_8 = ListItem(List=branch, Index=边号_2, Wrap=True)
addition_4 = Addition(A=item_8, B=amp_3)
addition_5 = Addition(A=addition_4, B=amp_2)
位距点 = Point(addition_4)
偏移点 = Point(addition_5)
位点 = Point(偏移点)
pline = PolyLine(Vertices=addition_3, Closed=True)
entwine = Entwine(
    Branch00=建筑类型_2,
    Branch01=原点_2,
    Branch02=角度_2,
    Branch03=位相_2,
    Branch04=宽深_2,
    Branch05=分参_2,
    Branch06=边号_2,
    Branch07=位距_2,
    Branch08=偏移_2,
    Branch09=boolean_2,
    FlattenInputs=True)
矩形 = Rectangle(pline)
确认数据 = Data(entwine)
矩形_2 = ClusterOutput(矩形)
位点_2 = ClusterOutput(位点)
角度_3 = ClusterOutput(角度_2)
确认数据_2 = ClusterOutput(确认数据)
