# Grasshopper definition 20181009_tim_ModelImport.gh (Grasshopper 1.0.4)

list = ValueList({"按建筑类型": 0, "按地块编号": 1}, selected="按建筑类型")
int = Integer(Slider(0, range=0..100))
txt = Text("C:\Users\htwt\Desktop\model-demo\01.skp")
int_2 = Integer(list)
pt = Point([Point(-3.745166838, -25.74614871, 0), Point(25.73268866, -42.67282174, 0), Point(26.54303433, -7.37462642, 0), Point(6.723286728, 10.88844698, 0), Point(36.34438012, 19.53725543, 0)])
python = GhPythonScript(flag=Toggle(False), clear_flag=Toggle(False), filepath=txt, coord=pt, angle=int, layerType=int_2)  # -> out, a; inputs flag: Boolean, clear_flag: Boolean, coord: Point3d, angle: Int32, layerType: Int32
# ---------- python: Python ----------
__author__ = "htwt"
__version__ = "2018.10.10"

import rhinoscriptsyntax as rs
import scriptcontext as sc
import Rhino
import math
import os


def changeLayer():
    return

def rotateMat(angle):
    radians = math.radians(angle)
    c = math.cos(radians)
    s = math.sin(radians)
    matrix = []
    matrix.append( [c,-s, 0, 0] )
    matrix.append( [s, c, 0, 0] )
    matrix.append( [0, 0, 1, 0] )
    matrix.append( [0, 0, 0, 1] )
    return matrix

def moveMat(coord):
    matrix = rs.XformTranslation(coord)
    return matrix

def transformModel(obj, coord, angle):
    xform = rs.XformMultiply(moveMat(coord), rotateMat(angle))
    rs.TransformObject( obj, xform, False)

def importModel(filepath, coords, angle):
    rs.Command("_-import " + filepath + " _Enter")
    # select Last object
    obj_id = rs.LastCreatedObjects()
    # changeLayerByName
    # move&rotate
    if obj_id:
        transformModel(obj_id, coord, angle)
    
    
def clear():
    objs = rs.AllObjects()
    rs.DeleteObjects(objs)

def main(flag):
    sc.doc = Rhino.RhinoDoc.ActiveDoc
    if flag:
        importModel(filepath, coord, angle)
    if clear_flag:
        clear()
    sc.doc = ghdoc

main(flag)
# ---------- end python ----------
number_slider = Slider(47, range=0..100)  # disabled
toggle = BooleanToggle(False)  # disabled
pt_2 = Point(Point(5.80782955, 39.79847313, 0))  # disabled
python_2 = GhPythonScript(flag=toggle, coord=pt_2, angle=number_slider)  # -> out, a; inputs flag: Boolean, coord: Vector3d, angle: Int32; disabled
# ---------- python_2: Python ----------
__author__ = "htwt"
__version__ = "2018.10.10"

import rhinoscriptsyntax as rs
import scriptcontext as sc
import Rhino
import math

def rotateMat(angle):
    radians = math.radians(angle)
    c = math.cos(radians)
    s = math.sin(radians)
    matrix = []
    matrix.append( [c,-s, 0, 0] )
    matrix.append( [s, c, 0, 0] )
    matrix.append( [0, 0, 1, 0] )
    matrix.append( [0, 0, 0, 1] )
    return matrix

def moveMat(coord):
    matrix = rs.XformTranslation(coord)
    return matrix

def main():

    xform = rs.XformMultiply(moveMat(coord), rotateMat(angle))
    sc.doc = Rhino.RhinoDoc.ActiveDoc
    obj = rs.GetObject("Select object to coodinate and rotate")
    if obj:
         rs.TransformObject( obj, xform, True)
    sc.doc = ghdoc

if (flag):
    main()
    flag = False
# ---------- end python_2 ----------
