# Grasshopper definition 20181011_tim_mergeParamsData.gh (Grasshopper 1.0.4)

number_slider = Slider(2, range=0..10)  # disabled
toggle = BooleanToggle(True)  # disabled
python = GhPythonScript(flag=toggle, wire_type=number_slider)  # -> out, a; inputs flag: Boolean, wire_type: Int32; disabled
# ---------- python: Python ----------
__author__ = "htwt"
__version__ = "2018.10.11"

import rhinoscriptsyntax as rs
import Grasshopper.Kernel.Data
from Grasshopper.Kernel import GH_ParamWireDisplay
from Grasshopper.Kernel import GH_RuntimeMessageLevel

wire_display = {'0':GH_ParamWireDisplay.default,
                 '1': GH_ParamWireDisplay.faint,
                 '2': GH_ParamWireDisplay.hidden}

if flag: 
    doc = ghenv.Component.OnPingDocument()
    sel_objs = doc.SelectedObjects()
    print(len(sel_objs))
    if len(sel_objs):
        ghenv.Component.AddRuntimeMessage(GH_RuntimeMessageLevel.Warning, "no select")
    for obj in sel_objs:
        if not hasattr(obj, 'Params'):continue
        for p in obj.Params.Input:
            p.WireDisplay = wire_display[str(wire_type)]
            #print("p.Sources = ", p.Sources)
        for param in obj.Params.Output:
            #print("i.Recipients = ", param.Recipients)
            #print("i.Sources = ", param.Sources)
            value = param.VolatileData.AllData(False)
            print(value)
            a = value
            count = param.VolatileDataCount
            print(count)
            
        
        """
        for i in obj.Params.Output:
            print(hasattr(i, 'GetValue'))
            print(i.CollectData())
            print(i)
        """
# ---------- end python ----------
python_2 = GhPythonScript()  # -> out, a; disabled
# ---------- python_2: Python ----------
__author__ = "htwt"
__version__ = "2018.10.11"

import rhinoscriptsyntax as rs
from Grasshopper.Kernel.GH_Component import Name, NickName, Params, PrincipalParameterIndex
import Grasshopper.Kernel.GH_Component as gh_component
import Grasshopper.Kernel.GH_ComponentParamServer as gh_cps
import Grasshopper.Kernel.Parameters as gkp
import Grasshopper.Kernel.IGH_Param as igh_param

def test():
    doc = ghenv.Component.OnPingDocument()
    sel_objs = doc.SelectedObjects()
    for obj in sel_objs:
        name = Name.GetValue(obj)
        nickName = NickName.GetValue(obj)
        paramServer = Params.GetValue(obj)
        param = gh_cps.Output.GetValue(paramServer)
        #param = paramServer.Output()
        print("name = ", name)
        print("nickName = ", nickName)
        print("paramServer = ", paramServer)
        print("index = ", PrincipalParameterIndex.GetValue(obj))
        print("outPutParam = ", param)
        print("len = ", len(param))
        for i in param:
            print(i)
            print(igh_param.Sources.GetValue(i))
            #print(igh_param.Reverse.GetValue(i))
            #print("i = ", gkp.Param_Number.GetValue(i, "a", True))
        #gkp.Param_Number.GetValue(obj, "a", True)
        #print("output = ", gh_component.GH_OutputParamManager(3))

def main():
    test()
    return 0


main()
# ---------- end python_2 ----------
number_slider_2 = Slider(3, range=1..5)
boolean = Boolean(Toggle(False))
开读 = Boolean(Toggle(False))
序号 = Integer([Slider(1, range=1..5), Slider(2, range=1..5)])
boolean_2 = Boolean(Toggle(False))
开读_2 = Boolean(Toggle(False))
序号_2 = Integer(Slider(4, range=1..5))
电池名称 = Text("ParentRectangle1.0")
合并电池数据0_3 = GhPythonScript(flag=开读_2, io_flag=boolean_2, paramIndex=序号_2, componentName=电池名称)  # -> out, data; inputs flag: Boolean, io_flag: Boolean
# ---------- 合并电池数据0_3: Python ----------
__author__ = "htwt"
__version__ = "2018.10.11"

import rhinoscriptsyntax as rs
from Grasshopper.Kernel import GH_RuntimeMessageLevel
from Grasshopper import DataTree
from Grasshopper.Kernel.Data import GH_Path

def main():
    doc = ghenv.Component.OnPingDocument()
    sel_objs = doc.SelectedObjects()
    if not sel_objs:
        ghenv.Component.AddRuntimeMessage(GH_RuntimeMessageLevel.Warning, "no selection!")
    dict = {}
    tree = DataTree[object]()
    i = 0
    for obj in sel_objs:
        if ((cmp(obj.Name, componentName)) or (not hasattr(obj, 'Params'))):continue
        print("run")
        if io_flag: param = obj.Params.Output[paramIndex-1]
        else: param = obj.Params.Input[paramIndex-1]
        if param:
            # maybe check access is list
            dataList = param.VolatileData.AllData(False)
            #lst = [item.Value for item in dataList]
            #dict[i] = lst
            tree.AddRange(dataList, GH_Path(i))
        i+=1
    data = tree
    return data

if flag:
    data = main()
# ---------- end 合并电池数据0_3 ----------
合并电池数据0_2 = GhPythonScript(flag=开读, io_flag=boolean, paramIndex=序号)  # -> out, data; inputs flag: Boolean, io_flag: Boolean
# ---------- 合并电池数据0_2: Python ----------
__author__ = "htwt"
__version__ = "2018.10.11"

import rhinoscriptsyntax as rs
from Grasshopper.Kernel import GH_RuntimeMessageLevel
from Grasshopper import DataTree
from Grasshopper.Kernel.Data import GH_Path

def main():
    doc = ghenv.Component.OnPingDocument()
    sel_objs = doc.SelectedObjects()
    if not sel_objs:
        ghenv.Component.AddRuntimeMessage(GH_RuntimeMessageLevel.Warning, "no selection!")
    dict = {}
    tree = DataTree[object]()
    i = 0
    for obj in sel_objs:
        if not hasattr(obj, 'Params'):continue
        if io_flag: param = obj.Params.Output[paramIndex-1]
        else: param = obj.Params.Input[paramIndex-1]
        if param:
            # maybe check access is list
            dataList = param.VolatileData.AllData(False)
            #lst = [item.Value for item in dataList]
            #dict[i] = lst
            tree.AddRange(dataList, GH_Path(i))
        i+=1
    data = tree
    return data

if flag:
    data = main()
# ---------- end 合并电池数据0_2 ----------
data = Data(合并电池数据0_2.data)
data_2 = Data(合并电池数据0_3.data)
series = Series(Start=0, Step=1, Count=10)
series_2 = Series(Start=0, Step=1, Count=10)
series_3 = Series(Start=Slider(9, range=0..10), Step=1, Count=Slider(4, range=0..10))
series_4 = Series(Start=0, Step=Slider(3, range=0..10), Count=Slider(2, range=0..10))
parentrectangle1_0 = ParentRectangle10(原点=Slider(3, range=0..10), 角度=Slider(3, range=0..10))  # -> 矩形_2, 位点_2, 角度_4, 确认数据_2

# ==== cluster ParentRectangle10
密钥 = ClusterInput()
建筑类型 = ClusterInput()
原点 = ClusterInput()
角度 = ClusterInput()
相位 = ClusterInput()
宽深 = ClusterInput()
分参 = ClusterInput()
边号 = ClusterInput()
位距 = ClusterInput()
偏移 = ClusterInput()
boolean = ClusterInput()
密钥_2 = Text(密钥)
建筑类型_2 = Integer(建筑类型)
原点_2 = Point(原点)
角度_2 = Integer(角度)
相位_2 = Integer(相位)
宽深_2 = Number(宽深)
分参_2 = Integer(分参)
边号_2 = Integer(边号)
位距_2 = Number(位距)
偏移_2 = Number(偏移)
boolean_2 = Boolean(boolean)
panel = Panel("""7gtu1hnee0t080wi
jihiaj77e14i0xa5""")
mindex = MemberIndex(Set=panel, Member=密钥_2)  # -> Index, Count
bool = Boolean(mindex.Count)
filter = StreamFilter(Gate=bool, Stream1=建筑类型_2)
filter_2 = StreamFilter(Gate=bool, Stream1=原点_2)
filter_3 = StreamFilter(Gate=bool, Stream1=角度_2)
filter_4 = StreamFilter(Gate=bool, Stream1=相位_2)
filter_5 = StreamFilter(Gate=bool, Stream1=宽深_2)
filter_6 = StreamFilter(Gate=bool, Stream1=分参_2)
filter_7 = StreamFilter(Gate=bool, Stream1=边号_2)
filter_8 = StreamFilter(Gate=bool, Stream1=位距_2)
filter_9 = StreamFilter(Gate=bool, Stream1=偏移_2)
filter_10 = StreamFilter(Gate=bool, Stream0=Slider(2, range=0..10), Stream1=boolean_2)
cluster = Cluster(
    建筑类型=filter,
    原点=filter_2,
    角度=filter_3,
    位相=filter_4,
    宽深=filter_5,
    分参=filter_6,
    边号=filter_7,
    位距=filter_8,
    偏移=filter_9,
    boolean=filter_10)  # -> 矩形_2, 位点_2, 角度_3, 确认数据_2
矩形 = Rectangle(cluster.矩形_2)
位点 = Point(cluster.位点_2)
角度_3 = Integer(cluster.角度_3)
确认数据 = Data(cluster.确认数据_2)
矩形_2 = ClusterOutput(矩形)
位点_2 = ClusterOutput(位点)
角度_4 = ClusterOutput(角度_3)
确认数据_2 = ClusterOutput(确认数据)

# ==== cluster Cluster
建筑类型 = ClusterInput()
原点 = ClusterInput()
角度 = ClusterInput()
位相 = ClusterInput()
宽深 = ClusterInput()
边号 = ClusterInput()
位距 = ClusterInput()
偏移 = ClusterInput()
boolean = ClusterInput()
分参 = ClusterInput()
建筑类型_2 = Text(建筑类型)
原点_2 = Point(原点)
角度_2 = Integer(角度)
边号_2 = Integer(边号)
boolean_2 = Boolean(boolean)
位距_2 = Number(位距)
偏移_2 = Number(偏移)
位相_2 = Integer(位相)
宽深_2 = Number(宽深)
分参_2 = Integer(分参)
pt = PointOriented(BasePlane=原点_2, UComponent=0, VComponent=0, WComponent=0)
rad = Radians(Degrees=角度_2)
item = ListItem(List=位相_2, Index="0", Wrap=True)
path = DataPath("0")
prot = RotatePlane(Plane=pt, Angle=rad)
lng = ListLength(List=位相_2)
series = Series(Start=位相_2, Step=1, Count=3)
mod = Modulus(A=位相_2, B=2)
addition = Addition(A=item, B=边号_2)

# ---- group: 非短路判断
mod_2 = Modulus(A=addition, B=2)
item_2 = ListItem(List=宽深_2, Index=mod_2, Wrap=True)
larger = LargerThan(FirstNumber=位距_2, SecondNumber=item_2)  # -> LargerThan, OrEqualTo
and = GateAnd(A=larger.LargerThan, B=boolean_2)
sift = SiftPattern(List=graft(位距_2), SiftPattern=graft(and))  # -> Output0, Output1
sift_2 = SiftPattern(List=graft(item_2), SiftPattern=graft(and))  # -> Output0, Output1
combine = CombineData(Input0=sift.Output0, Input1=sift_2.Output1)  # -> Result, Index
pshift = ShiftPaths(Data=combine.Result, Offset=-1)
实位距 = Number(pshift)

# ----
panel = Panel("""0
0.5*Pi
Pi
1.5*Pi""")
pln = Plane(prot)
panel_2 = Panel("""0,1,0
1,0,1""")
deplane = DeconstructPlane(Plane=pln)  # -> Origin, XAxis, YAxis, ZAxis
Z = UnitZ(Factor=1)
num = Number(panel)
item_3 = ListItem(List=panel_2, Index=mod, Wrap=True)
vrot = Rotate(Vector=deplane.XAxis, Axis=Z, Angle=num)
split = TextSplit(Text=item_3, Separators=",")
addition_2 = Addition(A=addition, B=1)
vec = Vector(vrot)
item_4 = ListItem(List=vec, Index=addition, Wrap=True)
item_5 = ListItem(List=vec, Index=series, Wrap=True)
item_6 = ListItem(List=宽深_2, Index=split, Wrap=True)
item_7 = ListItem(List=vec, Index=addition_2, Wrap=True)
vec_2 = VectorXYZ(XComponent=0, YComponent=0, ZComponent=0)  # -> Vector, Length
amp = Amplitude(Vector=item_5, Amplitude=item_6)
amp_2 = Amplitude(Vector=item_7, Amplitude=偏移_2)
amp_3 = Amplitude(Vector=item_4, Amplitude=实位距)
stack = StackData(Data=vec_2.Vector, Stack=lng)  # -> graft(Data)
ma = MassAddition(Input=amp)  # -> Result, PartialResults
merge = Merge(Data1=stack, Data2=ma.PartialResults)
pshift_2 = ShiftPaths(Data=merge, Offset=1)
addition_3 = Addition(A=deplane.Origin, B=pshift_2)
branch = TreeBranch(Tree=addition_3, Path=path, MaintainPaths=True)
item_8 = ListItem(List=branch, Index=边号_2, Wrap=True)
addition_4 = Addition(A=item_8, B=amp_3)
addition_5 = Addition(A=addition_4, B=amp_2)
位距点 = Point(addition_4)
偏移点 = Point(addition_5)
位点 = Point(偏移点)
pline = PolyLine(Vertices=addition_3, Closed=True)
entwine = Entwine(
    Branch00=建筑类型_2,
    Branch01=原点_2,
    Branch02=角度_2,
    Branch03=位相_2,
    Branch04=宽深_2,
    Branch05=分参_2,
    Branch06=边号_2,
    Branch07=位距_2,
    Branch08=偏移_2,
    Branch09=boolean_2,
    FlattenInputs=True)
矩形 = Rectangle(pline)
确认数据 = Data(entwine)
矩形_2 = ClusterOutput(矩形)
位点_2 = ClusterOutput(位点)
角度_3 = ClusterOutput(角度_2)
确认数据_2 = ClusterOutput(确认数据)
