# Grasshopper definition 20181013_tim_PresentSituationDescription.gh (Grasshopper 1.0.4)

位点 = Point()

excel = Text()
所有建筑类型 = Text(excel)
建筑类型 = Text()
位点_2 = Point(位点)
各类人各时刻建筑类型表_str = Text(excel)
panel = Panel([位点_2, 建筑类型])
panel_2 = Panel(各类人各时刻建筑类型表_str)
各建筑类型对应位点序号表 = Integer(panel)
总人数 = Integer(excel)
各类人各时刻建筑类型序号表 = Integer(panel_2)
各类人数分配比 = Number(excel)
各建筑类型对应位点序号表_2 = Integer(各建筑类型对应位点序号表)
panel_3 = Panel([各类人数分配比, 总人数, 各类人各时刻建筑类型序号表])
所有人各时刻建筑类型序号表 = Integer(panel_3)
某人某天各时刻建筑类型序号表 = Integer(所有人各时刻建筑类型序号表)
panel_4 = Panel([各建筑类型对应位点序号表_2, 某人某天各时刻建筑类型序号表])
某人各时刻对应建筑序号表 = Integer(panel_4)
所有人各时刻对应建筑序号表 = Integer(某人各时刻对应建筑序号表)

角度 = Point()
相位 = Point()
宽深 = Point()

角度_2 = Point()
相位_2 = Point()
panel_5 = Panel([角度_2, 相位_2])
实际角度 = Point(panel_5)
位点_3 = Point(位点)
角度_3 = Point(实际角度)
宽深_2 = Point(宽深)
文件路径 = Text()
模型 = Data()
panel_6 = Panel([位点_3, 角度_3, 宽深_2, 模型, 文件路径])
导入结果 = Data(panel_6)

道路始末位置 = Point()
data = Data()
data_2 = Data()

建筑类型表 = Text()
职业表 = Text()
各职业不同时段实际场所表 = Text()
实际场所与建筑类型映射表 = Integer()
各职业人数 = Integer()
panel_7 = Panel([职业表, 各职业不同时段实际场所表, 实际场所与建筑类型映射表, 建筑类型表, 各职业人数])
各时刻各建筑类型人员序号 = Integer(panel_7)

panel_8 = Panel([位点, 角度, 相位, 宽深])
panel_9 = Panel([道路始末位置, data, data_2])
中心线 = Curve(panel_9)

建筑类型_2 = Text()
建筑矩形 = Rectangle(panel_8)
panel_10 = Panel([建筑类型_2, 建筑矩形])
各类型建筑数量 = Integer(panel_10)

panel_11 = Panel("""C
A
D
B
A
C
B
C""")
panel_12 = Panel("""A
B
B
D
C
C
D
A""")
panel_13 = Panel("""各地块类型人数
各建筑人数
不同时段人的路径""")
rev = ReverseList(List=panel_11)
entwine = Entwine(Branch00=panel_12, Branch01=panel_11, Branch02=rev, FlattenInputs=True)
位点_4 = Point([Point(2619.252629, 1943.595096, 0), Point(2411.071565, 2066.611179, 0), Point(2782.01237, 2117.710168, 0), Point(2980.730659, 2394.023217, 0), Point(3105.639297, 2373.20511, 0), Point(3033.722202, 2197.197483, 0), Point(2867.177351, 2017.404746, 0), Point(2973.160438, 1924.669544, 0), Point(2878.532682, 1727.843811, 0), Point(3336.531023, 2528.394631, 0)])  # disabled
各时刻各建筑类型人数 = Integer(各时刻各建筑类型人员序号)
各类型建筑数量_2 = Integer(各类型建筑数量)
时刻序号 = Integer()
txt = Text(entwine)
位点_5 = Point(位点_4)  # disabled
区块轮廓 = Curve([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])
区块类型 = Text(["厂区", "加油站", "农田", "厂区", "厂区", "综合楼", "空地", "厂区", "政府机构", "农田"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])
建筑位点 = Point([Point(3093.407377, 1767.094451, 0), Point(3106.261597, 1765.534376, 0), Point(3115.393628, 1764.842249, 0), Point(3128.278833, 1766.56605, 0), Point(3127.336162, 1781.309995, 0), Point(3109.454979, 1826.277682, 0)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])
位点_6 = Point([Point(-22.04701985, 1.843497271, 0), Point(-11.7290957, 13.49276647, 0), Point(6.02217165, 19.04003752, 0), Point(12.45700606, 7.168877477, 0), Point(9.794315962, -9.251044823, 0), Point(2.915699863, -17.90478766, 0), Point(-16.61069422, -13.68886166, 0), Point(-11.95098654, -1.373919936, 0), Point(-1.078335291, 7.834550002, 0), Point(2.693809021, -1.484865357, 0)])
建筑位点_2 = Point(位点)
panel_14 = Panel([各时刻各建筑类型人数, 各类型建筑数量_2, 时刻序号])

路网 = Curve(中心线)
panel_15 = Panel(路网)
邻接关系 = Integer(panel_15)
路网结点 = Point(panel_15)
邻接距离 = Number(panel_15)

cluster = Cluster_5(建筑位点=建筑位点, 区块类型=区块类型, 区块轮廓=区块轮廓)
某时刻各建筑类型人员序号 = Integer(panel_14)
panel_16 = Panel(某时刻各建筑类型人员序号)
各时刻建筑人员序号 = Integer(panel_16)
某人员各时刻建筑序号 = Integer(各时刻建筑人员序号)
某人员各时刻建筑序号序 = Integer(某人员各时刻建筑序号)
panel_17 = Panel([某人员各时刻建筑序号序, 建筑位点_2])
各建筑人数 = Integer()
结束点 = Point(panel_17)
起始点 = Point(panel_17)
number_slider = Slider(50, range=0..100)
number_slider_2 = Slider(500, range=0..1000)
number_slider_3 = Slider(5000, range=0..10000)
number_slider_4 = Slider(2000, range=0..10000)
panel_18 = Panel("""A
B
A
C
D
A
C
B
D
B""")
panel_19 = Panel("""3
6
9""")
panel_20 = Panel("""A
B
C
D
E
F
G
H""")
现有路网 = Curve(路网)
现有路网结点 = Integer(路网结点)
结点邻接关系 = Integer(邻接关系)
起始点_2 = Point(起始点)
结束点_2 = Point(结束点)
位点建筑类型 = Text(cluster)
panel_21 = Panel([现有路网, 现有路网结点, 结点邻接关系, 起始点_2, 结束点_2])
更新结点邻接关系 = Integer(panel_21)
建筑结点编号1 = Integer(panel_21)
建筑结点编号2 = Integer(panel_21)
道路建筑节点邻接关系 = Integer(更新结点邻接关系)
建筑结点编号1_2 = Integer(建筑结点编号1)
建筑结点编号2_2 = Integer(建筑结点编号2)

# ---- group: 深度优先算法
结点序号1 = Integer()
邻接关系_2 = Integer()
结点序号2 = Integer()
panel_22 = Panel([邻接关系_2, 结点序号1, 结点序号2])
路径_结点序 = Integer(panel_22)

# ----
panel_23 = Panel([道路建筑节点邻接关系, 建筑结点编号1_2, 建筑结点编号2_2])
出行方式 = Integer()
邻接距离_2 = Number(邻接距离)
动向路径路径_结点序 = Text(panel_23)
动向路径路径_结点序_2 = Text(动向路径路径_结点序)
现有路网_2 = Curve(flatten([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]))
panel_24 = Panel([出行方式, 邻接距离_2, 动向路径路径_结点序_2])
现有路网_3 = Curve(现有路网_2)
交通时间 = Number(panel_24)
cluster_2 = Cluster_2(路网=现有路网_3)  # -> 路网结点_2, 邻接关系_2, 邻接距离_2
data_3 = Data()

number_slider_5 = Slider(2, range=0..100)
number_slider_6 = Slider(21, range=0..100)
series = Series(Start=Slider(3, range=0..100), Step=1, Count=Slider(8, range=0..10))
toggle = BooleanToggle(False)
path = FilePath("C:\Users\htwt\Desktop\20181014_人员时段建筑类型.xls")
number_slider_7 = Slider(2, range=0..10)
读取excel0_1 = 读取Excel01(
    开读=toggle,
    路径=path,
    表名="Sheet1",
    列号=Slider(12, range=0..100),
    首行=Slider(2, range=0..10),
    尾行=Slider(17, range=0..100),
    结构=False)
读取excel0_1_2 = 读取Excel01(开读=toggle, 路径=path, 表名="Sheet1", 列号=series, 首行=number_slider_5, 尾行=number_slider_6, 结构=False)
读取excel0_1_3 = 读取Excel01(开读=toggle, 路径=path, 表名="Sheet1", 列号=Slider(2, range=0..10), 首行=number_slider_5, 尾行=number_slider_6)
各类人各时刻建筑类型表_str_2 = Text(simplify(读取excel0_1_2))
所有建筑类型_2 = Text(读取excel0_1)
读取excel0_1_4 = 读取Excel01(开读=toggle, 路径=path, 表名="Sheet1", 列号=Slider(11, range=0..100), 首行=number_slider_7, 尾行=number_slider_7)
cluster_3 = Cluster_4(手工脏数据=所有建筑类型_2)
cluster_4 = Cluster_4(手工脏数据=各类人各时刻建筑类型表_str_2)
人数比例 = Integer(读取excel0_1_3)
位点建筑类型_2 = Text(cluster)
总人数_2 = Integer(读取excel0_1_4)
所有建筑类型_3 = Text(cluster_3)

flip = FlipMatrix(Data=cluster_4)

各类人各时刻建筑类型表_str_3 = Text(flip)

各类人各时刻建筑类型表_str_4 = Text(各类人各时刻建筑类型表_str_3)
所有建筑类型_4 = Text(所有建筑类型_3)
所有建筑类型_5 = Text(所有建筑类型_4)
python = GhPythonScript(allTypeName=所有建筑类型_5, type_lst=各类人各时刻建筑类型表_str_4)  # -> out, a; inputs allTypeName: list, type_lst: list
# ---------- python: Python ----------
__author__ = "htwt"
__version__ = "2018.10.14"

import random

# 用Hash表将中文类型映射到建筑类型序号
def getRecTypeIndex(typeName, hash):
    return [hash[name] for name in typeName]

# 获得把中文建筑类型映射成建筑类型序号的Hash表
def getHashFromWordToIndex(type_lst):
    hash = {}
    for i in range(len(type_lst)):
        hash[type_lst[i]] = i
    return hash

# 把所有中文建筑类型映射成序号
def getAllTypeIndex(recType_lst, personType_lst, allTypeName, hash):
    lst = [recType_lst, personType_lst, allTypeName]
    return [getRecTypeIndex(i, hash) for i in lst]

def main():
    hash_nameToIndex = getHashFromWordToIndex(allTypeName)
    type_i_lst = getRecTypeIndex(type_lst, hash_nameToIndex)
    return type_i_lst
a = main()
# ---------- end python ----------
各类人数分配比_2 = Number(人数比例)
总人数_3 = Integer(总人数_2)
各类人各时刻建筑类型序号表_2 = Integer(python.a)
基因条人数分配0_1 = 基因条人数分配01(各类人数分配比=各类人数分配比_2, 总人数=总人数_3, 各类人各时刻建筑类型序号表=各类人各时刻建筑类型序号表_2)
cluster_5 = Cluster_3(位点建筑类型=位点建筑类型, 所有建筑类型=所有建筑类型_4, 某人员各时刻建筑类型表_int=基因条人数分配0_1)
动向始末点0_4 = 动向始末点04(某人员各时刻建筑序号=cluster_5, 建筑位点=建筑位点)  # -> 起始点_2, 结束点_2
结束点_3 = Point(动向始末点0_4.结束点_2)
起始点_3 = Point(动向始末点0_4.起始点_2)
插入结点0_3 = 插入结点03(结点邻接关系=cluster_2.邻接关系_2, 现有路网结点=cluster_2.路网结点_2, 现有路网=现有路网_3, 起始点=起始点_3, 结束点=结束点_3)  # -> 更新结点邻接关系_2, 建筑结点编号1_2, 建筑结点编号2_2
遍历路径0_2 = 遍历路径02(道路建筑节点邻接关系=插入结点0_3.更新结点邻接关系_2, 建筑结点编号1=插入结点0_3.建筑结点编号1_2, 建筑结点编号2=插入结点0_3.建筑结点编号2_2)

# ==== cluster Cluster_2
路网 = ClusterInput()
路网_2 = Curve(路网)
mcx = MultipleCurves(Curves=路网_2)  # -> Points, IndexA, IndexB, ParamA, ParamB
# 生成中线交点
end = EndPoints(Curve=路网_2)  # -> Start, End
# 生成端点
crv = Curve(路网_2)
crv_2 = Curve(路网_2)
cset = CreateSet(List=mcx.Points)  # -> Set, Map
pt = Point([end.Start, end.End])
crv_3 = Curve([crv_2, crv])
cset_2 = CreateSet(List=pt)  # -> Set, Map
去除重合端点 = 去除重合端点(S=cset.Map, L=cset.Map)
# 去除重合端点
cluster = Cluster(L=cset_2.Map)
cull_i = CullIndex(List=mcx.ParamA, Indices=去除重合端点, Wrap=True)  # -> flatten(List)
cull_i_2 = CullIndex(List=mcx.ParamB, Indices=去除重合端点, Wrap=True)  # -> flatten(List)
cull_i_3 = CullIndex(List=mcx.IndexB, Indices=去除重合端点, Wrap=True)  # -> flatten(List)
cull_i_4 = CullIndex(List=mcx.IndexA, Indices=去除重合端点, Wrap=True)  # -> flatten(List)
cull_i_5 = CullIndex(List=crv_3, Indices=cluster, Wrap=True)
端点所在线 = Curve(cull_i_5)
端点 = Point(cset_2.Set)
intersection = SetIntersection(SetA=cset.Set, SetB=端点)
index = ItemIndex(List=端点, Item=intersection)
cull_i_6 = CullIndex(List=端点所在线, Indices=index, Wrap=True)  # -> flatten(List)
cull_i_7 = CullIndex(List=端点, Indices=index, Wrap=True)  # -> flatten(List)
端点所在线_2 = Curve(cull_i_6)
a线的编号 = Integer(cull_i_4)
b线的编号 = Integer(cull_i_3)
端点_2 = Point(cull_i_7)
交点 = Point(cset.Set)
index_2 = ItemIndex(List=路网_2, Item=端点所在线_2)
crv_cp = CurveClosestPoint(Point=端点_2, Curve=端点所在线_2)  # -> Point, Parameter, Distance
端点在曲线上的参量 = Number(crv_cp.Parameter)
在a曲线上参量 = Number([cull_i, 端点在曲线上的参量])
在b曲线上参量 = Number(cull_i_2)
a线的编号_2 = Integer([a线的编号, index_2])
b线的编号_2 = Integer(b线的编号)
交点_2 = Point([交点, 端点_2])
entwine = Entwine(Branch00=a线的编号_2, Branch01=b线的编号_2, FlattenInputs=True)
entwine_2 = Entwine(Branch00=在a曲线上参量, Branch01=在b曲线上参量, FlattenInputs=True)
flip = FlipMatrix(Data=entwine_2)
flip_2 = FlipMatrix(Data=entwine)
端点在曲线上的参量_2 = Number(flip)
所有节点 = Point(交点_2)
lng = ListLength(List=所有节点)
lng_2 = ListLength(List=路网_2)
series = Series(Start=0, Step=1, Count=lng)  # -> flatten(Series)
series_2 = Series(Start=0, Step=1, Count=lng_2)  # -> flatten(Series)
int = Integer(graft(series))
int_2 = Integer(series_2)
data = Data([int, flip_2, 端点在曲线上的参量_2])
panel = Panel("""0
1
3""")
panel_2 = Panel("""0
2
4""")
flip_3 = FlipMatrix(Data=data)
path = DataPath(panel)
path_2 = DataPath(panel_2)
simplify = SimplifyTree(Tree=flip_3, Front=False)
branch = TreeBranch(Tree=simplify, Path=path, MaintainPaths=True)
branch_2 = TreeBranch(Tree=simplify, Path=path_2, MaintainPaths=True)
bang = ExplodeTree(Data=branch)  # -> Branch0, Branch1, Branch2
bang_2 = ExplodeTree(Data=branch_2)  # -> Branch0, Branch1, Branch2
mindex = MemberIndex(Set=bang.Branch1, Member=int_2)  # -> Index, Count
item = ListItem(List=bang.Branch2, Index=mindex.Index, Wrap=True)
mindex_2 = MemberIndex(Set=bang_2.Branch1, Member=int_2)  # -> Index, Count
item_2 = ListItem(List=bang_2.Branch2, Index=mindex_2.Index, Wrap=True)
simplify_2 = SimplifyTree(Tree=item, Front=False)
simplify_3 = SimplifyTree(Tree=mindex.Index, Front=False)
simplify_4 = SimplifyTree(Tree=item_2, Front=False)
simplify_5 = SimplifyTree(Tree=mindex_2.Index, Front=False)
int_3 = Integer(simplify_5)
num = Number(simplify_4)
num_2 = Number(simplify_2)
int_4 = Integer(simplify_3)
data_2 = Data([num_2, num])
data_3 = Data([int_4, int_3])
sort = SortList(Keys=data_2)  # -> Keys, ValuesA
mindex_3 = MemberIndex(Set=sort.Keys, Member=data_2)  # -> Index, Count
pshift = ShiftPaths(Data=mindex_3.Index, Offset=-1)
replace = ReplaceItems(List=data_3, Item=data_3, Indices=pshift, Wrap=False)
每段中线上的点_从头到尾 = Integer(replace)
num_3 = Number(sort.Keys)
lng_3 = ListLength(List=num_3)
lng_4 = ListLength(List=每段中线上的点_从头到尾)
subtraction = Subtraction(A=lng_3, B=1)
subtraction_2 = Subtraction(A=lng_4, B=1)
stack = StackData(Data=2, Stack=lng_3)
stack_2 = StackData(Data=2, Stack=lng_4)
ins = InsertItems(List=subtraction, Item="0", Indices="0", Wrap=True)
ins_2 = InsertItems(List=subtraction_2, Item="0", Indices="0", Wrap=True)
simplify_6 = SimplifyTree(Tree=ins, Front=False)
simplify_7 = SimplifyTree(Tree=ins_2, Front=False)
simplify_8 = SimplifyTree(Tree=stack, Front=False)
simplify_9 = SimplifyTree(Tree=stack_2, Front=False)
# 确立两点关系
# (0；0)
# 第一个是中线标号
replace_2 = ReplaceItems(List=simplify_8, Item=1, Indices=simplify_6, Wrap=False)
# 确立两点关系
# (0；0)
# 第一个是中线标号
replace_3 = ReplaceItems(List=simplify_9, Item=1, Indices=simplify_7, Wrap=False)
stack_3 = StackData(Data=num_3, Stack=replace_2)
stack_4 = StackData(Data=每段中线上的点_从头到尾, Stack=replace_3)
partition = PartitionList(List=stack_3, Size=2)
partition_2 = PartitionList(List=stack_4, Size=2)
simplify_10 = SimplifyTree(Tree=partition, Front=False)
simplify_11 = SimplifyTree(Tree=partition_2, Front=False)
两点关系 = Integer(simplify_11)
item_3 = ListItem(List=simplify_10, Index=0, Wrap=True)
item_4 = ListItem(List=simplify_10, Index=1, Wrap=True)
subtraction_3 = Subtraction(A=item_3, B=item_4)
join = TextJoin(Text=两点关系, Join=",")  # -> flatten(Result)
abs = Absolute(Value=subtraction_3)  # -> flatten(Result)
路网结点 = Point(所有节点)
邻接关系 = Text(join)
邻接距离 = Number(abs)
路网结点_2 = ClusterOutput(路网结点)
邻接关系_2 = ClusterOutput(邻接关系)
邻接距离_2 = ClusterOutput(邻接距离)

# ==== cluster 遍历路径02
道路建筑节点邻接关系 = ClusterInput()
建筑结点编号2 = ClusterInput()
建筑结点编号1 = ClusterInput()
道路建筑节点邻接关系_2 = Text(道路建筑节点邻接关系)
建筑结点编号1_2 = Integer(建筑结点编号1)
建筑结点编号2_2 = Integer(建筑结点编号2)
path = GhPythonScript(releation=道路建筑节点邻接关系_2, start=建筑结点编号1_2, end=建筑结点编号2_2)  # -> simplify(out), a; inputs releation: list
# ---------- path: Python ----------
__author__ = "河妖"
__version__ = "2018.10.10"

import rhinoscriptsyntax as rs

y = len(releation)
class Node:
    def __init__(self,data):
        self.data = data
        self.next = None

class LinkedList:
    def __init__(self):
        self.head = None
        self.tail = None

    def append(self,data):
        node = Node(data)
        if self.head is None:
            self.head = node
            self.tail = node
        else:
            self.tail.next = node
            self.tail = node

merge = []
for i in range(0,y):
    link_list = LinkedList()
    link_list.append(i)
    merge.append(link_list)

for i in range(0,y):
    for z in range(0,len(releation)):
        a = releation[z].split(',',1)[0]
        b = releation[z].split(',',1)[1]
        if(i == int(a)):
            merge[i].append(int(b))
        elif(i == int(b)):
            merge[i].append(int(a))
        else:
            None

d = {}
for i in range(0,y):
    d[i] = 0
temp = []
anwser = []
def DFS(node,end):
    void = node.head
    if(void.data == end):
        temp.append(end)
        x = ""
        for q in range(0,len(temp)):
            x += str(temp[q])
            x += ","
        x = x[0:len(x)-1]
        print(x)
        anwser.append(temp)
        temp.pop()
    else:
        d[void.data] = 1
        temp.append(void.data)
        w = merge[void.data].head
        while(w != None):
            if(d[w.data] != 1):
                DFS(merge[w.data],end)
            w = w.next
            if(w == None):
                d[temp[-1]] = 0
                temp.pop()
                
DFS(merge[start],end)
# ---------- end path ----------
动向路径路径_结点序 = Text(path.out)
动向路径路径_结点序_2 = ClusterOutput(动向路径路径_结点序)

# ==== cluster 动向始末点04
某人员各时刻建筑序号 = ClusterInput()
建筑位点 = ClusterInput()
某人员各时刻建筑序号_2 = Integer(某人员各时刻建筑序号)
建筑位点_2 = Point(建筑位点)
shift = ShiftList(List=某人员各时刻建筑序号_2, Shift=[-1, 1], Wrap=False)
path_mapper = PathMapper(shift, source="{A;B;C}(i)", target="{A;B;i}(C)")
item = ListItem(List=建筑位点_2, Index=path_mapper, Wrap=True)
item_2 = ListItem(List=item, Index=0, Wrap=True)  # -> Item, Item1
pshift = ShiftPaths(Data=item_2.Item1, Offset=-1)
pshift_2 = ShiftPaths(Data=item_2.Item, Offset=-1)
起始点 = Point(pshift_2)
结束点 = Point(pshift)
起始点_2 = ClusterOutput(起始点)
结束点_2 = ClusterOutput(结束点)

# ==== cluster Cluster_3
某人员各时刻建筑类型表_int = ClusterInput()
所有建筑类型 = ClusterInput()
位点建筑类型 = ClusterInput()
某人员各时刻建筑类型表_int_2 = Integer(某人员各时刻建筑类型表_int)
位点建筑类型_2 = Text(位点建筑类型)
所有建筑类型_2 = Text(所有建筑类型)
python = GhPythonScript(recType_lst=位点建筑类型_2, allTypeName=所有建筑类型_2, personType_lst=某人员各时刻建筑类型表_int_2)  # -> out, a; inputs recType_lst: list, allTypeName: list, personType_lst: list of Int32
# ---------- python: Python ----------
__author__ = "htwt"
__version__ = "2018.10.14"

import random

# 获得每种建筑类型在图中对应的建筑序号
def hashAllRecType(recType_lst, allTypeName):
    tot_type_dict = {}   # 所有类序对应的建筑位点序号
    for i in range(len(allTypeName)): tot_type_dict[allTypeName[i]] = []
    for i in range(len(recType_lst)):
        tot_type_dict[recType_lst[i]].append(i)
    return tot_type_dict

# 某人某天每个时刻类型映射建筑位点序号(随机)
def typeMappingRecIndex(type_lst, tot_type_dict):
    dict = {}
    n = len(type_lst)
    index_lst = [0]*n
    for i in range(n):
        if not dict.has_key(type_lst[i]):
            dict[type_lst[i]] = random.choice(tot_type_dict[type_lst[i]])
        index_lst[i] = dict[type_lst[i]]
    return index_lst

# 用Hash表将中文类型映射到建筑类型序号
def getRecTypeIndex(typeName, hash):
    return [hash[name] for name in typeName]

# 获得把中文建筑类型映射成建筑类型序号的Hash表
def getHashFromWordToIndex(type_lst):
    hash = {}
    for i in range(len(type_lst)):
        hash[type_lst[i]] = i
    return hash

# 把所有中文建筑类型映射成序号
def getAllTypeIndex(recType_lst, allTypeName, hash):
    lst = [recType_lst, allTypeName]
    return [getRecTypeIndex(i, hash) for i in lst]

def main():
    hash_nameToIndex = getHashFromWordToIndex(allTypeName)
    #print("hash_nameToIndex = ", hash_nameToIndex)
    recType_i_lst, allTypeName_i = getAllTypeIndex(recType_lst, allTypeName, hash_nameToIndex)
    tot_type_dict = hashAllRecType(recType_i_lst, allTypeName_i)
    #print("tot_type_dict = ", tot_type_dict)
    index_lst = typeMappingRecIndex(personType_lst, tot_type_dict)
    #print("index_lst = ", index_lst)
    return index_lst
a = main()
# ---------- end python ----------
某人员各时刻建筑序号序 = Integer(python.a)
某人员各时刻建筑序号序_2 = ClusterOutput(某人员各时刻建筑序号序)

# ==== cluster 读取Excel01
开读 = ClusterInput()
路径 = ClusterInput()
表名 = ClusterInput()
列号 = ClusterInput()
首行 = ClusterInput()
尾行 = ClusterInput()
结构 = ClusterInput()
表名_2 = Text(表名)
开读_2 = Boolean(开读)
路径_2 = Text(路径)
列号_2 = Integer(列号)
首行_2 = Integer(首行)
尾行_2 = Integer(尾行)
结构_2 = Boolean(结构)
vb = VBScript(read=开读_2, FilePath=路径_2, SheetName=表名_2, Column=列号_2, startRow=首行_2, endRow=尾行_2, isStructed=结构_2)  # -> out, A
# ---------- vb: VB ----------
    If read = True Then
      Dim xl As Object
      Dim xlbook As Object
      xl = CreateObject("excel.application")
      'xl.Visible = False
      Dim st As Object
      xlbook = xl.Workbooks.Open(FilePath)
      st = xlbook.Worksheets(SheetName)

      'Dim ans As String
      'ans = st.Cells(i, j).Value
      Dim i As Integer
      Dim lst(endRow-startRow) As String
      Dim value As String
      Dim j As Integer
      j = 0
      For i = startRow To endRow Step 1
        value = st.Cells(i, Column).value
        If (value = "" And isStructed = False) Then
          Continue For
        End If
        'lst.AddItems(value)
        lst(j) = value
        j = j + 1
      Next
      ReDim Preserve lst(j-1)
      'A = st.Cells(i, Column).Value
      A = lst
      xl = Nothing
      xlbook = Nothing
    End If
# ---------- end vb ----------
数据 = Data(vb.A)
数据_2 = ClusterOutput(数据)

# ==== cluster Cluster_4
手工脏数据 = ClusterInput()
手工脏数据_2 = Text(手工脏数据)
python = GhPythonScript(str=手工脏数据_2)  # -> out, a
# ---------- python: Python ----------
# -*- coding=utf-8 -*-
"""Provides a scripting component.
    Inputs:
        x: The x script variable
        y: The y script variable
    Output:
        a: The a output variable"""

__author__ = "htwt"
__version__ = "2018.10.14"
import os, sys, string

def filterString(str): 
    #return filter(lambda ch: ch not in '. ', str)
    return str.strip()
a = filterString(str)
# ---------- end python ----------
清理后的数据 = Text(python.a)
panel = Panel(清理后的数据)
清理后的数据_2 = ClusterOutput(清理后的数据)

# ==== cluster 基因条人数分配01
各类人各时刻建筑类型序号表 = ClusterInput()
各类人数分配比 = ClusterInput()
总人数 = ClusterInput()
各类人各时刻建筑类型序号表_2 = Integer(各类人各时刻建筑类型序号表)
各类人数分配比_2 = Number(各类人数分配比)
总人数_2 = Integer(总人数)
ma = MassAddition(Input=各类人数分配比_2)  # -> Result, PartialResults
join = TextJoin(Text=各类人各时刻建筑类型序号表_2, Join=",")
division = Division(A=各类人数分配比_2, B=ma.Result)
multiplication = Multiplication(A=division, B=总人数_2)
int = Integer(graft(multiplication))
stack = StackData(Data=join, Stack=int)  # -> simplify(Data)
split = TextSplit(Text=stack, Separators=",")
某人员各时刻建筑类型序号表 = Integer(split)
某人员各时刻建筑类型序号表_2 = ClusterOutput(某人员各时刻建筑类型序号表)

# ==== cluster 插入结点03
现有路网 = ClusterInput()
起始点 = ClusterInput()
结束点 = ClusterInput()
现有路网_2 = Curve(现有路网)
结束点_2 = Point(结束点)
起始点_2 = Point(起始点)
结点邻接关系 = ClusterInput()
现有路网结点 = ClusterInput()
结点邻接关系_2 = Text(结点邻接关系)
现有路网结点_2 = Point(现有路网结点)
crv_cp = CurveClosestPoint(Point=起始点_2, Curve=现有路网_2)  # -> Point, Parameter, Distance
panel = Panel(起始点_2)
crv_cp_2 = CurveClosestPoint(Point=结束点_2, Curve=现有路网_2)  # -> Point, Parameter, Distance
sort = SortList(Keys=crv_cp.Distance)  # -> Keys, ValuesA
sort_2 = SortList(Keys=crv_cp_2.Distance)  # -> Keys, ValuesA
lng = ListLength(List=现有路网结点_2)
item = ListItem(List=sort.Keys, Index=0, Wrap=True)
item_2 = ListItem(List=sort_2.Keys, Index=0, Wrap=True)
lng_2 = ListLength(List=现有路网结点_2)
addition = Addition(A=lng, B=1)
mindex = MemberIndex(Set=crv_cp.Distance, Member=item)  # -> Index, Count
mindex_2 = MemberIndex(Set=crv_cp_2.Distance, Member=item_2)  # -> Index, Count
start_numbert = Integer(lng_2)
end_numbert = Integer(addition)
panel_2 = Panel(item_2)
item_3 = ListItem(List=结点邻接关系_2, Index=mindex.Index, Wrap=True)
item_4 = ListItem(List=结点邻接关系_2, Index=mindex_2.Index, Wrap=True)
split = TextSplit(Text=item_3, Separators=",")
split_2 = TextSplit(Text=item_4, Separators=",")
item_5 = ListItem(List=split, Index=1, Wrap=True)  # -> simplify(Item)
item_6 = ListItem(List=split, Index=0, Wrap=True)  # -> simplify(Item)
item_7 = ListItem(List=split_2, Index=0, Wrap=True)
item_8 = ListItem(List=split_2, Index=1, Wrap=True)
panel_3 = Panel(item_3)
concat = Concatenate(FragmentA=start_numbert, FragmentB=",")
concat_2 = Concatenate(FragmentA=item_6, FragmentB=",")
concat_3 = Concatenate(FragmentA=end_numbert, FragmentB=",")
concat_4 = Concatenate(FragmentA=item_7, FragmentB=",")
int = Integer(simplify([mindex.Index, mindex_2.Index]))
panel_4 = Panel(concat_2)
concat_5 = Concatenate(FragmentA=concat_2, FragmentB=start_numbert)  # -> simplify(Result)
concat_6 = Concatenate(FragmentA=concat_3, FragmentB=item_8)  # -> simplify(Result)
concat_7 = Concatenate(FragmentA=concat, FragmentB=item_5)  # -> simplify(Result)
concat_8 = Concatenate(FragmentA=concat_4, FragmentB=end_numbert)  # -> simplify(Result)
cull_i = CullIndex(List=结点邻接关系_2, Indices=int, Wrap=True)  # -> simplify(List)
panel_5 = Panel(concat_8)
panel_6 = Panel(concat_5)
merge = Merge(Data1=concat_5, Data2=concat_7, Data3=concat_8, Data4=concat_6, Data5=cull_i)
panel_7 = Panel(merge)
更新结点邻接关系 = Text(merge)

建筑结点编号1 = Integer(start_numbert)
建筑结点编号2 = Integer(end_numbert)

更新结点邻接关系_2 = ClusterOutput(更新结点邻接关系)
建筑结点编号1_2 = ClusterOutput(建筑结点编号1)
建筑结点编号2_2 = ClusterOutput(建筑结点编号2)

# ==== cluster Cluster_5
建筑位点 = ClusterInput()
区块类型 = ClusterInput()
区块轮廓 = ClusterInput()
区块类型_2 = Text(区块类型)
建筑位点_2 = Point(建筑位点)
区块轮廓_2 = Curve(区块轮廓)
incurves = PointInCurves(Point=flatten(建筑位点_2), Curves=flatten(区块轮廓_2))  # -> Relationship, Index, Point
sort = SortList(Keys=incurves.Index, ValuesA=建筑位点_2)  # -> Keys, ValuesA
cset = CreateSet(List=sort.Keys)  # -> Set, Map
lng = ListLength(List=cset.Set)
series = Series(Start=0, Step=1, Count=lng)
num = Number(graft(cset.Set))
equals = Equality(FirstNumber=graft(series), SecondNumber=cset.Map)  # -> Equality, Inequality
cull = CullPattern(List=equals.Equality, CullPattern=equals.Equality)
lng_2 = ListLength(List=cull)
stack = StackData(Data=num, Stack=lng_2)
item = ListItem(List=区块类型_2, Index=stack, Wrap=True)
flatten = FlattenTree(Tree=item, Path="{0}")
建筑对应地块类型 = Text(flatten)
建筑对应地块类型_2 = ClusterOutput(建筑对应地块类型)

# ==== cluster Cluster
L = ClusterInput()
cset = CreateSet(List=L)  # -> Set, Map
mindex = MemberIndex(Set=cset.Map, Member=cset.Set)  # -> Index, Count
lng = ListLength(List=mindex.Index)
larger = LargerThan(FirstNumber=lng, SecondNumber=1)  # -> LargerThan, OrEqualTo
cull = CullPattern(List=mindex.Index, CullPattern=larger.LargerThan)
shift = ShiftList(List=cull, Shift=1, Wrap=False)  # -> flatten(List)
L_2 = ClusterOutput(shift)

# ==== cluster 去除重合端点
L = ClusterInput()
S = ClusterInput()
cset = CreateSet(List=L)  # -> Set, Map
mindex = MemberIndex(Set=S, Member=cset.Set)  # -> Index, Count
lng = ListLength(List=mindex.Index)
larger = LargerThan(FirstNumber=lng, SecondNumber=1)  # -> LargerThan, OrEqualTo
cull = CullPattern(List=mindex.Index, CullPattern=larger.LargerThan)  # -> flatten(List)
shift = ShiftList(List=cull, Shift=1, Wrap=False)
L_2 = ClusterOutput(shift)
