# Grasshopper definition 20181029_blockArrangeGh.gh (Grasshopper 1.0.4)

panel = Panel("""普通小区,1200
学校,800
农田,2300
公园,300
工厂,4000
农田自建房,1000
鱼塘,800
菜市场,200
棋牌室,350
警署,200
河边旧民居,1200
宾馆,600
小饭馆,800
医院,400
咖啡馆,200
洗浴中心,700
超市,540
老年活动中心,280
茶馆,280
网吧,190
别墅,1400
政府,800
船,300""")
merge = Merge(Data1=Slider(1, range=0..1))
split = TextSplit(Text=panel, Separators=",")
ma = MassAddition(Input=merge)  # -> Result, PartialResults
item = ListItem(List=split, Index=0, Wrap=True)  # -> flatten(Item), flatten(Item1)
merge_2 = Merge(Data1=Slider(2, range=0..10), Data2=Slider(4, range=0..10))
division = Division(A=merge, B=ma.Result)
建筑类型索引 = Integer(Slider(2, range=0..10))
所有建筑类型 = Text(item.Item)
建筑类型建筑面积 = Text(item.Item1)
地块总面积 = Number(Slider(2100, range=0..10000))
现有面积 = Number(Slider(200, range=0..1000))
建筑面积_建筑占地比例 = Number(division)
number_slider = Slider(0.6, range=0..10)
number_slider_2 = Slider(36.8, range=0..100)
subtraction = Subtraction(A=地块总面积, B=现有面积)
item_2 = ListItem(List=所有建筑类型, Index=建筑类型索引, Wrap=True)
item_3 = ListItem(List=建筑类型建筑面积, Index=建筑类型索引, Wrap=True)
可用地块面积 = Number(subtraction)
mindex = MemberIndex(Set=所有建筑类型, Member=item_2)  # -> Index, Count
larger = LargerThan(FirstNumber=可用地块面积, SecondNumber="0")  # -> LargerThan, OrEqualTo
已用建筑面积 = Number(Slider(200, range=0..1000))
建筑类型面积 = Number(item_3)
number_slider_3 = Slider(50.44, range=0..100)
number_slider_4 = Slider(67.1, range=0..100)
容积率 = Number()
覆盖率 = Number(Slider(0.3, range=0..1))
建筑面积_建筑占地比例_2 = Number()
层数 = Integer(Slider(1, range=0..10))
栋数 = Integer(Slider(10, range=0..10))
# 暂时: 前面的判断结果 不传递给后面 机制通用性会变差
底面积 = Number()
建筑类型 = Integer(mindex.Index)
filter = StreamFilter(Gate=larger.LargerThan, Stream1=可用地块面积)
bool = Boolean(Slider(0, range=0..100))
subtraction_2 = Subtraction(A=建筑类型面积, B=已用建筑面积)
filter_2 = StreamFilter(Gate=bool, Stream0=覆盖率, Stream1=容积率)
可用地块面积_2 = Number(filter)
num = Number(Slider(893.3, range=0..1000))
num_2 = Number()
int = Integer(Slider(3, range=0..10))
初始可用建筑面积 = Number(graft(subtraction_2))
multiplication = Multiplication(A=可用地块面积_2, B=filter_2)
merge_3 = Merge(Data1=num, Data2=int, Data3=num_2)
gate = StreamGate(Stream=multiplication, Gate=bool)  # -> Target0, Target1
bool_2 = Boolean(num_2)
panel_2 = Panel(初始可用建筑面积)
总建筑面积 = Number(gate.Target1)
filter_3 = StreamFilter(Gate=0)
bool_3 = Boolean(merge_3)
栋数_2 = Integer(Slider(2, range=0..10))
总占地面积 = Number(Slider(45.3, range=0..100))
各栋底面积 = Number(Slider(11.08, range=0..100))
总占地面积_2 = Number(gate.Target0)

multiplication_2 = Multiplication(A=总建筑面积, B=建筑面积_建筑占地比例_2)
各类型建筑面积 = Number(multiplication_2)

总建筑面积_2 = Number(Slider(72, range=0..100))
层数_2 = Integer(Slider(6, range=0..10))
栋数_3 = Integer(Slider(1, range=0..10))
底面积_2 = Number(Slider(22.75, range=0..100))
mindex_2 = MemberIndex(Set=bool_3, Member=Toggle(True))  # -> Index, Count
merge_4 = Merge(Data1=num, Data2=filter_3, Data3=num_2)
multiplication_3 = Multiplication(A=总占地面积_2, B=建筑面积_建筑占地比例_2)
层数_3 = Integer(层数)
栋数_4 = Integer(栋数)
底面积_3 = Number(底面积)
join = TextJoin(Text=mindex_2.Index)
python = GhPythonScript(input_a=总建筑面积_2, input_f=层数_2, input_pa=底面积_2)  # -> out, a, f, n, pa; inputs input_f: Int32, input_n: Int32
# ---------- python: Python ----------
__author__ = "dell"
__version__ = "2018.10.29"

import rhinoscriptsyntax as rs


def computeThreeParams(a = 0.0, b = 0, c = 0.0):
    if a and b: c = a / b
    elif a and c: 
        b = int(a / c) + 1
        c = a / b
    elif b and c:  a = b * c
    else: return
    return a, b, c


def computeFourParams(a = 0.0, f = 0, n = 0, pa = 0.0):
    if a and f and n: pa = a/f/n
    elif a and f and pa:
        n = int(a/f/pa)+1
        pa = a/f/n
    elif a and n and pa:
        f = int(a/n/pa)+1
        pa = a/f/n
    elif f and n and pa: a = f*n*pa
    else: return
    return a, f, n, pa


#a, b, c = computeThreeParams(x, y, z)

a, f, n, pa = computeFourParams(input_a, input_f, input_n, input_pa)
# ---------- end python ----------
python_2 = GhPythonScript(x=总占地面积, y=栋数_2)  # -> out, a, b, c; inputs y: Int32
# ---------- python_2: Python ----------
__author__ = "dell"
__version__ = "2018.10.29"

import rhinoscriptsyntax as rs


def computeThreeParams(a = 0.0, b = 0, c = 0.0):
    if a and b: c = a / b
    elif a and c: 
        b = int(a / c) + 1
        c = a / b
    elif b and c:  a = b * c
    else: return
    return a, b, c

a, b, c = computeThreeParams(x, y, z)
# ---------- end python_2 ----------
panel_3 = Panel("""01
02
12""")
各类型占地面积 = Number(multiplication_3)
栋数_5 = Integer(栋数)
各栋底面积_2 = Number(底面积)
mindex_3 = MemberIndex(Set=panel_3, Member=join)  # -> Index, Count
python_3 = GhPythonScript(input_a=各类型建筑面积, input_f=层数_3, input_n=栋数_4, input_pa=底面积_3)  # -> out, a, f, n, pa; inputs input_f: Int32, input_n: Int32; same code as python
merge_5 = Merge(Data1=python_2.a, Data2=python_2.b, Data3=python_2.c)
merge_6 = Merge(Data1=python.a, Data2=python.f, Data3=python.n, Data4=python.pa)
python_4 = GhPythonScript(x=各类型占地面积, y=栋数_5, z=各栋底面积_2)  # -> out, a, b, c; inputs y: Int32; same code as python_2
filter_4 = StreamFilter(Gate=0)
gate_2 = StreamGate(Gate=mindex_3.Index)  # -> Target0, Target1, Target2
panel_4 = Panel(merge_5)
panel_5 = Panel(merge_6)
各类型占地面积_2 = Number(python_4.a)
各栋底面积_3 = Number(python_4.c)
栋数_6 = Integer(python_4.b)
各类型建筑面积_2 = Number(python_3.a)
层数_4 = Integer(层数)
层数_5 = Integer(python_3.f)
栋数_7 = Integer(python_3.n)
底面积_4 = Number(python_3.pa)
python_5 = GhPythonScript(y=栋数_7, z=底面积_4)  # -> out, a, b, c; inputs y: Int32; same code as python_2
各类型占地面积_3 = Number(python_5.a)
ma_2 = MassAddition(Input=各类型占地面积_3)  # -> Result, PartialResults
总占地面积_3 = Number(ma_2.Result)
smaller = SmallerThan(FirstNumber=总占地面积_3, SecondNumber=可用地块面积_2)  # -> SmallerThan, OrEqualTo
filter_5 = StreamFilter(Gate=smaller.OrEqualTo, Stream1=总占地面积_3)
ma_3 = MassAddition(Input=各类型建筑面积_2)  # -> Result, PartialResults
multiplication_4 = Multiplication(A=栋数_7, B=底面积_4)

可用总占地面积 = Number(filter_5)
可用地块面积_3 = Number(可用地块面积_2)
division_2 = Division(A=可用总占地面积, B=可用地块面积_3)
覆盖率_2 = Number(division_2)

python_6 = GhPythonScript(input_f=层数_4, input_n=栋数_6, input_pa=各栋底面积_3)  # -> out, a, f, n, pa; inputs input_f: Int32, input_n: Int32; same code as python
总建筑面积_3 = Number(ma_3.Result)
各类型占地面积_4 = Number(multiplication_4)
ma_4 = MassAddition(Input=各类型占地面积_4)  # -> Result, PartialResults
subtraction_3 = Subtraction(A=初始可用建筑面积, B=各类型建筑面积_2)
smaller_2 = SmallerThan(FirstNumber=总建筑面积_3, SecondNumber=总建筑面积)  # -> SmallerThan, OrEqualTo
各类型建筑面积_3 = Number(python_6.a)
剩余建筑面积 = Number(subtraction_3)
panel_6 = Panel("""300
400
153""")
ma_5 = MassAddition(Input=各类型占地面积_2)  # -> Result, PartialResults
subtraction_4 = Subtraction(A=初始可用建筑面积, B=各类型建筑面积_3)
filter_6 = StreamFilter(Gate=smaller_2.OrEqualTo, Stream1=总建筑面积_3)

所有类型可用建筑面积 = Number(panel_6)
建筑类型_2 = Integer(Slider(1, range=0..1))
当前建筑面积 = Number(Slider(120, range=0..1000))
item_4 = ListItem(List=所有类型可用建筑面积, Index=建筑类型_2, Wrap=False)
bool_4 = Boolean(当前建筑面积)
filter_7 = StreamFilter(Gate=bool_4, Stream1=item_4)
subtraction_5 = Subtraction(A=filter_7, B=当前建筑面积)
larger_2 = LargerThan(FirstNumber=subtraction_5, SecondNumber="0")  # -> LargerThan, OrEqualTo
bool_5 = Boolean(larger_2.OrEqualTo)

# ---- group: 占地面积判断
可用地块总面积 = Number(Slider(120, range=0..1000))
计算总占地面积 = Number(Slider(27, range=0..1000))
smaller_3 = SmallerThan(FirstNumber=计算总占地面积, SecondNumber=可用地块总面积)  # -> SmallerThan, OrEqualTo
bool_6 = Boolean(smaller_3.OrEqualTo)

# ----
总占地面积_4 = Number(ma_5.Result)

# ---- group: 建筑面积判断
计算总面积 = Number(Slider(27, range=0..1000))
可用面积 = Number(Slider(120, range=0..1000))
smaller_4 = SmallerThan(FirstNumber=计算总面积, SecondNumber=可用面积)  # -> SmallerThan, OrEqualTo
bool_7 = Boolean(smaller_4.OrEqualTo)

# ----
剩余建筑面积_2 = Number(subtraction_4)
larger_3 = LargerThan(FirstNumber=剩余建筑面积, SecondNumber="0")  # -> LargerThan, OrEqualTo
larger_4 = LargerThan(FirstNumber=剩余建筑面积_2, SecondNumber="0")  # -> LargerThan, OrEqualTo
总建筑面积_4 = Number(filter_6)
smaller_5 = SmallerThan(FirstNumber=总占地面积_4, SecondNumber=可用地块面积_2)  # -> SmallerThan, OrEqualTo
filter_8 = StreamFilter(Gate=larger_3.OrEqualTo, Stream1=各类型建筑面积_2)
filter_9 = StreamFilter(Gate=larger_4.OrEqualTo, Stream1=各类型建筑面积_3)
filter_10 = StreamFilter(Gate=smaller_5.OrEqualTo, Stream1=总占地面积_4)
各类型建筑面积_4 = Number(filter_8)
可用总占地面积_2 = Number(filter_10)
计算限制 = Boolean(smaller_5.OrEqualTo)
现状限制 = Boolean(larger_3.OrEqualTo)
可用各类型建筑面积 = Number(filter_9)

可用地块面积_4 = Number(可用地块面积_2)
ma_6 = MassAddition(Input=可用各类型建筑面积)  # -> Result, PartialResults
division_3 = Division(A=ma_6.Result, B=可用地块面积_4)
容积率_2 = Number(division_3)

计算限制_2 = Boolean(smaller_5.OrEqualTo)
现状限制_2 = Boolean(larger_4.OrEqualTo)
and = GateAnd(A=计算限制, B=现状限制)
and_2 = GateAnd(A=计算限制_2, B=现状限制_2)
建筑类型_3 = Integer(建筑类型)
各类型建筑面积_5 = Number(各类型建筑面积_3)
各类型占地面积_5 = Number(各类型占地面积_2)
类型剩余建筑面积 = Number(剩余建筑面积_2)
容积率_3 = Number(容积率_2)
层数_6 = Integer(层数_4)
栋数_8 = Integer(栋数_6)
底面积_5 = Number(各栋底面积_3)
覆盖率_3 = Number(覆盖率)
各类型建筑面积_6 = Number(各类型建筑面积_2)
类型剩余建筑面积_2 = Number(剩余建筑面积)
容积率_4 = Number(容积率)
层数_7 = Integer(层数_5)
建筑类型_4 = Integer(建筑类型)
各类型占地面积_6 = Number(各类型占地面积_4)
覆盖率_4 = Number(覆盖率_2)
栋数_9 = Integer(栋数_7)
底面积_6 = Number(底面积_4)
merge_7 = Merge(
    Data1=flatten(建筑类型_3),
    Data2=flatten(各类型建筑面积_5),
    Data3=flatten(各类型占地面积_5),
    Data4=flatten(类型剩余建筑面积),
    Data5=flatten(容积率_3),
    Data6=flatten(覆盖率_3),
    Data7=flatten(层数_6),
    Data8=flatten(栋数_8),
    Data9=flatten(底面积_5))
merge_8 = Merge(
    Data1=flatten(建筑类型_4),
    Data2=flatten(各类型建筑面积_6),
    Data3=flatten(各类型占地面积_6),
    Data4=flatten(类型剩余建筑面积_2),
    Data5=flatten(容积率_4),
    Data6=flatten(覆盖率_4),
    Data7=flatten(层数_7),
    Data8=flatten(栋数_9),
    Data9=flatten(底面积_6))
pt = Point(Point(-15.57427862, -4.252025274, 0))
complex = ComplexComponents(Complex=pt)  # -> Real, Imaginary
临时间距 = Number(Slider(56, range=0..1000))
栋数_10 = Integer(Slider(4, range=0..10))
底面积_7 = Number(Slider(543, range=0..1000))
层数_8 = Integer(层数_4)
层高系数 = Number(Slider(3.2, range=0..10))
层数_9 = Integer(层数_4)
series = Series(Start=complex.Real, Step=临时间距, Count=栋数_10)
sqrt = SquareRoot(Value=底面积_7)
multiplication_5 = Multiplication(A=层数_9, B=层高系数)
complex_2 = CreateComplex(Real=series, Imaginary=complex.Imaginary)
pt_2 = Point(complex_2)
Z = UnitZ(Factor=1)
amp = Amplitude(Vector=Z, Amplitude=multiplication_5)
rectangle = Rectangle(Plane=pt_2, XSize=sqrt, YSize=sqrt, Radius=0)  # -> Rectangle, Length
boundary = BoundarySurfaces(Edges=rectangle.Rectangle)
extr = Extrude(Base=boundary, Direction=amp)
