# Grasshopper definition 20181002_tim_convertBetweenExcelAndGh.gh (Grasshopper 1.0.4)

panel = Panel("C:\Users\chen\Desktop\test.xlsx")
panel_2 = Panel("C:\Users\chen\Desktop\timspace\arch\town-design\future-life\place-time_data.xlsx")
toggle = BooleanToggle(True)
txt = Text("Sheet1")
toggle_2 = BooleanToggle(False)
txt_2 = Text("C:\Users\chen\Desktop\test-tim.xls")
int = Integer(Slider(1, range=0..1))
int_2 = Integer(Slider(105, range=0..1000))
int_3 = Integer(Slider(2, range=0..10))
series = Series(Start=Slider(2, range=0..10), Step=1, Count=Slider(8, range=0..10))
列序号 = Integer(series)
cluster = Cluster(开始读=toggle, xls文件路径=txt_2, 工作簿名称=txt, 列序号=int, 起始行号=int_3, 结束行号=int_2, 是否保留结构=toggle_2)  # -> out, data
cluster_2 = Cluster(开始读=toggle, xls文件路径=txt_2, 工作簿名称=txt, 列序号=列序号, 起始行号=int_3, 结束行号=int_2, 是否保留结构=toggle_2)  # -> out, data
viewer = ParamViewer()
txt_3 = Text("arr1")
panel_3 = Panel("""2
3""")
panel_4 = Panel("""2
125""")
cset = CreateSet(List=flatten(cluster_2.data))  # -> Set, Map
item = ListItem(List=panel_4, Index=0, Wrap=True)  # -> Item, Item1
cluster_3 = Cluster(开始读=toggle, xls文件路径=txt_2, 工作簿名称=txt_3, 列序号=panel_3, 起始行号=item.Item, 结束行号=item.Item1, 是否保留结构=toggle_2)  # -> out, data
bang = ExplodeTree(Data=cluster_3.data)  # -> Branch0, Branch1
replace = ReplaceMembers(Set=cluster_2.data, Find=bang.Branch0, Replace=bang.Branch1)  # -> simplify(Result)
graft = GraftTree(Tree=replace, IncludeEmptyLists=True, IncludeNullItems=True)
panel_5 = Panel(bang.Branch0)
path = ConstructPath(Indices=graft)
viewer_2 = ParamViewer(graft)
panel_6 = Panel(bang.Branch1)
replace_2 = ReplacePaths(Data=graft, Search=viewer_2, Replace=flatten(path))
panel_7 = Panel(cluster_3.data)
viewer_3 = ParamViewer(replace_2)
panel_8 = Panel(replace)

# ==== cluster Cluster
开始读 = ClusterInput()
xls文件路径 = ClusterInput()
工作簿名称 = ClusterInput()
列序号 = ClusterInput()
起始行号 = ClusterInput()
结束行号 = ClusterInput()
是否保留结构 = ClusterInput()
xls文件路径_2 = Text(xls文件路径)
工作簿名称_2 = Text(工作簿名称)
是否保留结构_2 = Boolean(是否保留结构)
开始读_2 = Boolean(开始读)
结束行号_2 = Integer(结束行号)
起始行号_2 = Integer(起始行号)
列序号_2 = Integer(列序号)
python = GhPythonScript(read=开始读_2, filepath=xls文件路径_2, worksheetname=工作簿名称_2, column=列序号_2, startRow=起始行号_2, endRow=结束行号_2, isStructed=是否保留结构_2)  # -> out, data; inputs isStructed: Boolean
# ---------- python: Python ----------
# -*- coding: utf-8 -*-
"""Provides a scripting component.
    依赖xlrd和xlwt, 确认~\Rhino 6\Plug-ins\IronPython\Lib中存在他们
    Inputs:
        read: 
        filepath: 
        worksheetname:
        column:
        startRow:
        endRow:
        isStructed: 是否保留结构
    Output:
        Data: The a output variable"""

__author__ = "chen"
__version__ = "2018.10.02"

import rhinoscriptsyntax as rs
from xlrd import open_workbook
from xlwt import Workbook


def main():
    data = []
    input_file = filepath
    input_workbook = open_workbook(input_file)
    
    with open_workbook(input_file) as workbook:
        # if worksheet.nrows < startRow or worksheet.nrows < endRow or colum    边界条件
        worksheet = workbook.sheet_by_name(worksheetname)
        for row_index in range(startRow, endRow+1):
            value = worksheet.cell_value(row_index-1, column-1)
            if (not isStructed and value == ''):continue;
            data.append(value)
    return data

if (read):
    data = main()
# ---------- end python ----------
data = ClusterOutput(python.data)
out = ClusterOutput(python.out)
