# Grasshopper definition picArrange.gh (Grasshopper 0.9.80)
# plug-ins: Python Interpreter

python = PythonScript(flag=Toggle(True), rootPath="/Users/htwt/timspace/arch/town-design/collection/")  # -> out, a; inputs flag: Boolean
# ---------- python: Python ----------
"""Provides a scripting component.
    Inputs:
        flag: The x script variable
        rootpath: The y script variable
    Output:
        a: The a output variable"""
# -*- coding: UTF-8 -*-
__author__ = "htwt"

import rhinoscriptsyntax as rs
import os
import shutil

# 提取该物件的图层名字(放在数组中)
def getObjectsLayerNames():
	obj_ids = rs.GetObjects("Please select points", rs.filter.point, False, True)
	names = []
	for id in obj_ids:
		names.append(rs.ObjectLayer(id))
	return names

# 图层名字转换成路径
def layerNamesToPaths(rootPath, layerNames):
	finalPaths_lst = []
	for layerName in layerNames:
		s_lst = layerName.split('::')
		finalPath = rootPath
		for i in range(1, len(s_lst)):
			finalPath = os.path.join(finalPath, s_lst[i])
		finalPaths_lst.append(finalPath)
		print("finalPath = " + finalPath)
	return finalPaths_lst

# 通过路径打开多个文件
def viewPic(prevPath):
	# 得到文件夹下照片数量cnt
	L = []
	for root, dirs, files in os.walk(prevPath):
		for file in files:
			suffix = os.path.splitext(file)[1]
			if suffix == '.png' or suffix == '.jpg' or suffix == 'jpeg':
				L.append(os.path.join(root, file))
	# join中间添加空格
	open_sh = 'open'
	for fpath in L:
		print('fpath = ' + fpath)
		#appendPath = os.path.join(prevPath, cnt+1)
		open_sh += ' ' + fpath
		#os.system('open /Users/htwt/timspace/arch/town-design/CY/M-08/01/01.png /Users/htwt/timspace/arch/town-design/CY/M-08/01/02.png')
	print("open_sh = " + open_sh)
	os.system(open_sh)


#调用多个路径, 每个路径打开对应的多张照片
def viewMorePathPic(prevPaths_lst):
	for prevPath in prevPaths_lst:
		viewPic(prevPath)

if (flag):
	layerNames = getObjectsLayerNames()
	#a = layerNames
	#print(a)
	finalPaths_lst = layerNamesToPaths(rootPath, layerNames)
	#a = finalPath
	#viewPic(finalPath)
	viewMorePathPic(finalPaths_lst)
# ---------- end python ----------
panel = Panel(python.out)
panel_2 = Panel(python.a)
